# Dynamo graph AHN_CloudCompare.dyn (Dynamo 1.3.2.2480)

string = StringInput("""import sys
sys.path.append("C:\Program Files (x86)\IronPython 2.7\Lib")
import webbrowser

links = IN[0]

for link in links:
 webbrowser.open(link)
 
OUT = links""")
open_downloadlink = PythonStringNode(script=string)  # unwired: IN[0]

# group: INPUT
directory_laszip = CodeBlock { "C:/TEMP"; }
filepath_laz_pointcloud = Filename("..\..\..\..\..\Downloads\u43bz2.laz (1)\u43bz2.laz")
code_block = CodeBlock { "Den Bommel"; "Bommelsedijk"; "1"; }
boundingbox = CodeBlock { 50; }
new_filename = CodeBlock { "CROPPED4.laz"; }

getLocationdataNetherlands = Custom[GIS2BIM.GetLocationdataNetherlands](City=code_block.out0, Streetname=code_block.out1, Housenumber=code_block.out2)  # Gives locationdata based on an adress in the Netherlands
code_block_2 = CodeBlock(x=getLocationdataNetherlands.RDcoordinate_X_meters, y=getLocationdataNetherlands.RDcoordinate_Y_meters, width=boundingbox) { x; y; width; }

# group: CREATE BATCHFILE
code_block_3 = CodeBlock { "/"; "cropped4.bat"; }
concat = String.Concat(directory_laszip, code_block_3.out0, code_block_3.out1)
downloadLASZIP = Custom[GIS2BIM.DownloadLASZIP](Directory=directory_laszip)  # download and unzip laszip
code_block_4 = CodeBlock { " -i "; }
code_block_5 = CodeBlock { "-keep_classification 2 "; ""; " -oparse xyz"; }
string_2 = StringInput("\"")
code_block_6 = CodeBlock { " -translate_x -"; " -translate_y -"; }
toString = Custom[Springs.Number.ToString](num=code_block_2.x)  # Converts the input number(s) to string. You can optionally limit the number of digits.
toString_2 = Custom[Springs.Number.ToString](num=code_block_2.y)
code_block_7 = CodeBlock { " -inside "; " "; }
code_block_8 = CodeBlock(x=code_block_2.x, bbox=code_block_2.width, y=code_block_2.y) { x-0.5*bbox; x+0.5*bbox; y-0.5*bbox; y+0.5*bbox; }
toString_3 = Custom[Springs.Number.ToString](num=code_block_8.out0)
toString_4 = Custom[Springs.Number.ToString](num=code_block_8.out2)
toString_5 = Custom[Springs.Number.ToString](num=code_block_8.out1)
toString_6 = Custom[Springs.Number.ToString](num=code_block_8.out3)
code_block_9 = CodeBlock { " -odir "; " -o "; }
string_3 = StringInput("\"")
concat_2 = String.Concat(downloadLASZIP.Laszip, code_block_4, code_block_5.out1, string_2, filepath_laz_pointcloud, string_2, code_block_6.out0, toString, code_block_6.out1, toString_2, code_block_7.out0, toString_3, code_block_7.out1, toString_4, code_block_7.out1, toString_5, code_block_7.out1, toString_6, code_block_9.out0, string_2, directory_laszip, string_2, code_block_9.out1, string_3, new_filename, string_3)
writeToFile = CSV.WriteToFile(concat, concat_2)

code_block_10 = CodeBlock { "luchtfoto"; }
webrequestWMS = Custom[GIS2BIM.WebrequestWMS](View=code_block_10)  # a webrequest based on WMS-protocol; unwired: WMSwebrequest, Tempfolder, Filename
createBoundingBox = Custom[GIS2BIM.CreateBoundingBox](CoordinateX=getLocationdataNetherlands.RDcoordinate_X_meters, CoordinateY=getLocationdataNetherlands.RDcoordinate_Y_meters, BoxWidth=boundingbox, BoxHeight=boundingbox)  # create boundingboxstring for webrequests based on coördinates and dimensions
geoservicesLibraryNetherlands = Custom[GIS2BIM.GeoservicesLibraryNetherlands](BoundingBox=createBoundingBox)  # Library with multiple webadresses which can be used for WFS and WMS webrequests
webrequestWMS_2 = Custom[GIS2BIM.WebrequestWMS](WMSwebrequest=geoservicesLibraryNetherlands.5_luchtfoto_2016_WMS, Filename=code_block_10)
watch_image = WatchImageCore(webrequestWMS_2.watch_image)
downloadAHN = Custom[GIS2BIM.DownloadAHN](Urlwebrequest=geoservicesLibraryNetherlands.11_AHN2_webrequest_bladindex)  # get the mapnumber(s) of the AHN based on a given boundingbox
sendTo = Custom[Clipboard.SendTo](str=downloadAHN.Downloadlink_AHN2_uitgefilterd)  # Copies a string to the clipboard.
